vi "GenerateQuestions.gviweb"   [LabVIEW NXG 2.1.0]
outputs:
  "Question in String": string
  "Answer": enum{"Correct", "Wrong"}
diagram:
  Random Number() -> (number (0 to 1)=w1)
  Is Greater(x=w1, y=0.5) -> w2
  Random Number() -> (number (0 to 1)=w3)
  Multiply(w3, 10) -> w4
  To Byte Integer(number=w4) -> w5
  Array Index(array=[1, 2, 3, 1, 4, 3, 1, 3, 3, 2, 3]) -> (out0[w5]=w6)
  Random Number() -> (number (0 to 1)=w7)
  Multiply(w7, 10) -> w8
  To Byte Integer(number=w8) -> w9
  Array Index(array=[2, 10, 6, -2, -10, 10, -10, 8, -8, 2, -2]) -> (out0[w9]=w10)
  Random Number() -> (number (0 to 1)=w11)
  Multiply(w11, 10) -> w12
  To Long Integer(number=w12) -> w13
  Random Number() -> (number (0 to 1)=w14)
  Multiply(w14, 100) -> w15
  To Long Integer(number=w15) -> w16
  Random Number() -> (number (0 to 1)=w17)
  Multiply(w17, 100) -> w18
  To Long Integer(number=w18) -> w19
  Random Number() -> (number (0 to 1)=w20)
  Multiply(w20, 10) -> w21
  To Long Integer(number=w21) -> w22
  case (w6) {
    frame 0, Default {
      w23 = default
    }
    frame 1 {
      Number To Decimal String(number=w19) -> (decimal integer string=w24)
      Number To Decimal String(number=w16) -> (decimal integer string=w25)
      Add(w16, w19) -> w26
      Add(w26, w10) -> w27
      Select(s=w2, t=w26, f=w27) -> w28
      Number To Decimal String(number=w28) -> (decimal integer string=w29)
      Concatenate Strings(w25, "  +   ", w24, "  =   ", w29) -> w23
    }
    frame 2 {
      Number To Decimal String(number=w19) -> (decimal integer string=w30)
      Number To Decimal String(number=w16) -> (decimal integer string=w31)
      Subtract(x=w16, y=w19) -> w32
      Add(w32, w10) -> w33
      Select(s=w2, t=w32, f=w33) -> w34
      Number To Decimal String(number=w34) -> (decimal integer string=w35)
      Concatenate Strings(w31, "  -   ", w30, "  =   ", w35) -> w23
    }
    frame 3 {
      Number To Decimal String(number=w13) -> (decimal integer string=w36)
      Number To Decimal String(number=w16) -> (decimal integer string=w37)
      Multiply(w16, w13) -> w38
      Add(w38, w10) -> w39
      Select(s=w2, t=w38, f=w39) -> w40
      Number To Decimal String(number=w40) -> (decimal integer string=w41)
      Concatenate Strings(w37, "  *   ", w36, "  =   ", w41) -> w23
    }
    frame 4 {
      Number To Decimal String(number=w13) -> (decimal integer string=w42)
      Number To Decimal String(number=w16) -> (decimal integer string=w43)
      Divide(x=w16, y=w13) -> w44
      Add(w44, w10) -> w45
      Select(s=w2, t=w44, f=w45) -> w46
      Number To Fractional String(number=w46, precision (6)=2) -> (F-format string=w47)
      Concatenate Strings(w43, "  \\   ", w42, "  =   ", w47) -> w23
    }
  }
  $"Question in String" <- w23
  Select(s=w2, t="Correct", f="Wrong") -> w48
  $Answer <- w48
