vi "QuickAnswer.gviweb"   [LabVIEW NXG 3.0.0]
panel controls:
  "Correct": bool
  "Wrong": bool
  "Start\\Stop": bool
panel indicators:
  "Question": string
  "Status": string
uses:
  WebGame::GenerateQuestions.gviweb
diagram:
  Get Current Time() -> (current time=w1)
  s1 = uninitialised  # shift register
  s2 = w1  # shift register
  s3 = 0  # shift register
  s4 = 0  # shift register
  s5 = TRUE  # shift register
  while {
    Logical Or($Correct, $Wrong) -> w2
    Select(s=$Correct, t="Correct", f="Wrong") -> w3
    Is Equal(x=s1, y=w3) -> w4
    case (w2) {
      frame False, Default {
        w5 = s3
        w6 = s4
      }
      frame True {
        case (w4) {
          frame False, Default {
            Increment(x=s4) -> w6
            w5 = s3
          }
          frame True {
            Increment(x=s3) -> w5
            w6 = s4
          }
        }
      }
    }
    case ($"Start\\Stop") {
      frame False, Default {
        Get Current Time() -> (current time=w9)
        w7 = 0
        w8 = 0
      }
      frame True {
        Number To Decimal String(number=w5) -> (decimal integer string=w10)
        Number To Decimal String(number=w6) -> (decimal integer string=w11)
        Get Current Time() -> (current time=w12)
        Time Stamp Subtract(x=w12, y=s2) -> w13
        Divide(x=w13, y=w5) -> w14
        Number To Fractional String(number=w14) -> (F-format string=w15)
        Concatenate Strings("Correct answer count: ", w10, "\nWrong answer count: ", w11, "\nCorrect answer pace: ", w15) -> w16
        $Status <- w16
        w7 = w5
        w8 = w6
        w9 = s2
      }
    }
    Logical Or(w2, s5) -> w17
    case (w17) {
      frame False, Default {
        w18 = s1
      }
      frame True {
        call "GenerateQuestions.gviweb"() -> (Question in String=w19, Answer=w18)
        $Question <- w19
      }
    }
    Wait(time to wait=10)
    next s1 = w18
    next s2 = w9
    next s3 = w7
    next s4 = w8
    next s5 = FALSE
    stop if FALSE
  }
